vi "index.gviweb"   [LabVIEW NXG 5.1.0]
panel controls:
  "value_IN": bool
panel indicators:
  "value_OUT": bool
diagram:
  # Place setup code before the loop. For example, perform initial data communication and wire the results into the loop.
  s1 = FALSE  # shift register
  while (iteration -> i1) {
    Not(x=s1) -> w1
    Quotient And Remainder(x=i1, y=20) -> (x-y*floor(x/y)=w2)
    Is Equal To 0(x=w2) -> w3
    Select(s=w3, t=w1, f=s1) -> w4
    Select(s=$value_IN, t=$value_IN, f=w4) -> w5
    $value_OUT <- w5
    Wait(time to wait=50)
    next s1 = w5
    stop if FALSE
  }
